# Grasshopper definition HopsTest.gh (Grasshopper 1.0.8)
# plug-ins: Geospiza

# ---- group: Genes
cube_vals = GenePool(Decimals=0, Maximum=500, Minimum=1, Value=[86.14909746, 407.457315, 449.6100064])

# ---- group: Get Genes
geneselector = GeneSelector(GeneParams=cube_vals, SearchDocument=False, Clear=False)
genes = Text(geneselector)

# ---- group: Geometric_Solver
list_item = ListItem(List=cube_vals, Index=0, Wrap=True)  # -> Item, Item1, Item2
unit_z = UnitZ(Factor=list_item.Item2)
rectangle = Rectangle(Plane=PlaneXY(0, 0, 0), XSize=list_item.Item, YSize=list_item.Item1, Radius=0)  # -> Rectangle, Length
extrude = Extrude(Base=rectangle.Rectangle, Direction=unit_z)
cap_holes = CapHoles(Brep=extrude)
geometry = Geometry(cap_holes)

# ----
ibf = Slider(0.2, range=0..1)
manhattendistance = Slider(1, range=0..1)
mr = Slider(0.01, range=0..0.01)
pops = Slider(4, range=0..10)
cr = Slider(0.6, range=0..1)
inbreedingpairing = InbreedingPairing(InBreedingFactor=ibf, DistanceFunction=manhattendistance)
twopointcrossover = TwoPointCrossover(CrossoverRate=cr)
randommutation = RandomMutation(MutationRate=mr)
populationdiversity = PopulationDiversity(Threshold=pops)
pops_2 = Slider(50, range=0..100)
mgen = Slider(10, range=0..10)
elite = Slider(1, range=0..10)
stochasticuniversalsampling = StochasticUniversalSampling()
settings = Settings(
    PopulationSize=pops_2,
    MaxGenerations=mgen,
    EliteSize=elite,
    SelectionStrategy=stochasticuniversalsampling,
    PairingStrategy=inbreedingpairing,
    CrossoverStrategy=twopointcrossover,
    MutationStrategy=randommutation,
    TerminationStrategy=populationdiversity)
settings_2 = Data(settings)

# ---- group: Fitness_Function
volume = Volume(Geometry=cap_holes)  # -> Volume, Centroid
division = Division(A=volume.Volume, B="1000000")
number = Number(division)
addition = Addition(A=number)
fitness = Fitness(Fitness=addition)

# ---- group: Geometric_Solver / RH_OUT: Data
geometry_2 = Geometry(geometry)

# ----
settings_3 = Data(settings_2)

forwebonly = Panel("0")
timestamp = GetInteger(forwebonly, {"0"}, selected=[], AtLeast=1, AtMost=1, Maximum=2147483647, Minimum=-2147483648, TreeAccess=False)
genes_2 = Text(genes)
singleobjectivesolver = SingleObjectiveSolver(Gene=genes_2, Settings=settings_3, Timestamp=timestamp, Run=Button())  # -> Observer, StateManager, CurrentGeneration, IsRunning
statemanager = Data(singleobjectivesolver.StateManager)
panel = Panel(singleobjectivesolver.CurrentGeneration)
panel_2 = Panel(singleobjectivesolver.IsRunning)

observer = Data(singleobjectivesolver.Observer)
context_print = ContextPrint(NumberGeneration=panel)
context_print_2 = ContextPrint(IsRunning=panel_2)
observer_2 = Observer(Observer=observer)  # -> Individuals, AverageFitness, BestFitness, WorstFitness, BestIndividual
individual = Individual(Individual=observer_2.Individuals)  # -> Fitness, Genes
