# Grasshopper definition Building_Evaluator_Example.gh (Grasshopper 1.0.7)
# plug-ins: Geospiza

# ---- group: Genes
wlc_floors = GenePool(Decimals=2, Maximum=0.8, Minimum=0.2, Value=[0.33, 0.73, 0.69, 0.27, 0.24])
wlc_floors_2 = GenePool(Decimals=0, Maximum=10, Minimum=4, Value=[5, 8, 9, 7, 5])
number = Number(wlc_floors)
# Gene's need to be directly connected to the gene selector component
number_2 = Number(wlc_floors_2)
geneselector = GeneSelector(GeneParams=[wlc_floors, wlc_floors_2], SearchDocument=False, Clear=False)
genes = Text(geneselector)

# ----
stochasticuniversalsampling = StochasticUniversalSampling()
inbreedingpairing = InbreedingPairing(InBreedingFactor=0.2, DistanceFunction=1)
twopointcrossover = TwoPointCrossover(CrossoverRate="0.6")
randommutation = RandomMutation(MutationRate=0.01)
populationdiversity = PopulationDiversity(Threshold=2)

# ---- group: Timestamp to trigger with compute
timestamp = GetString("0", AtLeast=1, AtMost=1, TreeAccess=False)

# ---- group: Evo_Solver
settings = Settings(
    PopulationSize=Slider(10, range=0..100),
    MaxGenerations=Slider(20, range=0..100),
    EliteSize=Slider(0, range=0..100),
    SelectionStrategy=stochasticuniversalsampling,
    PairingStrategy=inbreedingpairing,
    CrossoverStrategy=twopointcrossover,
    MutationStrategy=randommutation,
    TerminationStrategy=populationdiversity)
genes_2 = Text(genes)
singleobjectivesolver = SingleObjectiveSolver(Genes=genes_2, Settings=settings, PreviewLevel=0, Timestamp=timestamp, Run=Button())  # -> Observer, StateManager, CurrentGeneration, IsRunning

# ----
observer = Observer(Observer=singleobjectivesolver.Observer)  # -> Individuals, AverageFitness, BestFitness, WorstFitness, BestIndividual
individual = Individual(Individual=observer.Individuals)  # -> Fitness, Genes
list_item = ListItem(List=observer.Individuals, Index=0, Wrap=True)
decodegene = DecodeGene(Gene=individual.Genes)  # -> GeneName, GeneValue, GeneGuid
reinstateindividual = ReinstateIndividual(StateManager=singleobjectivesolver.StateManager, Individual=list_item, Reinstate=Button())

# ---- group: Some_GH_Solution
curve = Curve(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)
negative = Negative(Value=Slider(5000, range=0..5000))
offset_curve = OffsetCurve(Curve=curve, Distance=negative, Plane=PlaneXY(0, 0, 0), Corners=1)
curve_2 = Curve(offset_curve)
curve_3 = Curve(curve_2)
explode = Explode(Curve=curve_3, Recursive=True)  # -> Segments, Vertices
number_3 = Number(number)
shatter = Shatter(Curve=reparameterize(simplify(graft(explode.Segments))), Parameters=simplify(graft(number_3)))  # -> simplify(Segments)
list_item_2 = ListItem(List=shatter, Index=0, Wrap=True)
curve_4 = Curve(list_item_2)
area = Area(Geometry=curve_3)  # -> Area, Centroid
rectangle = Rectangle(Plane=PlaneXY(0, 0, 0), XSize=Domain(-1, 1), YSize=Domain(-2, 2), Radius=0)  # -> Rectangle, Length
floor_height = Slider(3000, range=0..10000)
number_4 = Number(number_2)
series = Series(Start=0, Step=floor_height, Count=expr("x+1", number_4))
unit_z = UnitZ(Factor=series)
md_slider = MDSlider(SliderMode=0, slider_value=Point(0.5, 0.5, 0.5), x_domain=Domain(0, 1), y_domain=Domain(0, 1), z_domain=Domain(0, 1))

# ----
end_points = EndPoints(Curve=curve_4)  # -> Start, End
boundary_surfaces = BoundarySurfaces(Edges=curve_3)

# ---- group: Some_GH_Solution (continued)
line = Line(StartPoint=simplify(area.Centroid), EndPoint=simplify(end_points.Start))

# ----
surface_split = SurfaceSplit(Surface=boundary_surfaces, Curves=flatten(line))
brep_edges = BrepEdges(Brep=surface_split)  # -> Naked, Interior, NonManifold

# ---- group: Some_GH_Solution (continued)
join_curves = JoinCurves(Curves=brep_edges.Naked, Preserve=False)
flip_curve = FlipCurve(Curve=join_curves, Guide=rectangle.Rectangle)  # -> simplify(Curve), Flag
boundary_surfaces_2 = BoundarySurfaces(Edges=flip_curve.Curve)
move = Move(Geometry=boundary_surfaces_2, Motion=unit_z)  # -> Geometry, Transform
brep_edges_2 = BrepEdges(Brep=move.Geometry)  # -> simplify(Naked), Interior, NonManifold
join_curves_2 = JoinCurves(Curves=brep_edges_2.Naked, Preserve=False)  # -> simplify(Curves)
shift_paths = ShiftPaths(Data=join_curves_2, Offset=-1)
cull_index = CullIndex(List=shift_paths, Indices="-1", Wrap=True)
shift_list = ShiftList(List=shift_paths, Shift=1, Wrap=False)
list_item_3 = ListItem(List=shift_paths, Index="-1", Wrap=True)
merge = Merge(Data1=simplify(graft(cull_index)), Data2=simplify(graft(shift_list)))
cap = Brep(list_item_3)
loft = Loft(Curves=merge, Options={Adjust=False, Closed=False, LoftEnds=0, LoftSimp=0, LoftType=3, Rebuild=10, Refit=0.01})
deconstruct_brep = DeconstructBrep(Brep=loft)  # -> reparameterize(simplify(graft(Faces))), Edges, Vertices
evaluate_surface = EvaluateSurface(Surface=deconstruct_brep.Faces, Point=md_slider)  # -> Point, Normal, UDirection, VDirection, Frame
amplitude = Amplitude(Vector=evaluate_surface.Normal, Amplitude=Slider(0.01, range=0..0.01))
move_2 = Move(Geometry=deconstruct_brep.Faces, Motion=amplitude)  # -> Geometry, Transform
mesh_brep = MeshBrep(
    Brep=move_2.Geometry,
    Settings={GridMaxCount=0, GridMinCount=16, JaggedSeams=False, MaxEdgeLength=0, MinEdgeLength=0.0001, MinTolerance=0, Refine=True, RefineAngle=0, RelativeTolerance=0.65, SimplePlanes=True, Tolerance=0})
reverse = Reverse(Vector=evaluate_surface.Normal)
mesh_ray = MeshRay(Mesh=flatten(mesh_brep), Point=simplify(evaluate_surface.Point), Direction=simplify(reverse))  # -> Point, Hit
mass_addition = MassAddition(Input=mesh_ray.Hit)  # -> Result, PartialResults
equality = Equality(FirstNumber=mass_addition.Result, SecondNumber="0")  # -> Equality, Inequality
cull_pattern = CullPattern(List=simplify(deconstruct_brep.Faces), CullPattern=invert(simplify(equality.Equality)))  # -> flatten(List)
cull_pattern_2 = CullPattern(List=simplify(deconstruct_brep.Faces), CullPattern=simplify(equality.Equality))  # -> flatten(List)
outerfaces = Brep(cull_pattern_2)
innerfaces = Brep(cull_pattern)

# ---- group: Fitness_Function
outerfaces_2 = Brep(outerfaces)
list_length = ListLength(List=outerfaces_2)

# ----
area_2 = Area(Geometry=outerfaces_2)  # -> Area, Centroid

# ---- group: Fitness_Function (continued)
mass_addition_2 = MassAddition(Input=area_2.Area)  # -> Result, PartialResults
division = Division(A=mass_addition_2.Result, B=list_length)
division_2 = Division(A=division, B=1000000)
fitness = Fitness(Fitness=division_2)

# ---- group: WebOutput
colour_swatch = ColourSwatch(SwatchColor=RGB(114, 161, 106))
number_slider = Slider(1, range=0..1)
colour_swatch_2 = ColourSwatch(SwatchColor=RGB(255, 112, 112))
colour_swatch_3 = ColourSwatch(SwatchColor=RGB(255, 255, 255))
number_slider_2 = Slider(1, range=0..1)
outerfaces_3 = Brep(outerfaces_2)
innerfaces_2 = Brep(innerfaces)
cap_2 = Brep(cap)
fitness_2 = Number(division_2)
gh_aditionaldata = GH_AditionalData(Key="Fitness", Value=fitness_2)

# ----
threematerial = ThreeMaterial(Color=colour_swatch_3, Metalness=0, Roughness=number_slider_2, Opacity=number_slider)
threematerial_2 = ThreeMaterial(Color=colour_swatch_2, Metalness=0, Roughness=0.5, Opacity=1)
threematerial_3 = ThreeMaterial(Color=colour_swatch, Metalness=0, Roughness=0.5, Opacity=1)
webindividual = WebIndividual(Geo=outerfaces_3, ThreeMaterial=threematerial_3)
webindividual_2 = WebIndividual(Geo=innerfaces_2, ThreeMaterial=threematerial_2)
webindividual_3 = WebIndividual(Geo=cap_2, ThreeMaterial=threematerial)

# ---- group: WebOutput (continued)
merge_2 = Merge(Data1=webindividual, Data2=webindividual_2, Data3=webindividual_3)
geospiza_link = GeospizaLink(WebGeo=merge_2, AdditionalData=gh_aditionaldata, Endpoint="http://127.0.0.1:5173/api/apiEndpoint", Listen=Toggle(False))

# ---- group: WebOutput / GH_Preview
custom_preview = CustomPreview(Geometry=outerfaces_3, Material=colour_swatch)
custom_preview_2 = CustomPreview(Geometry=innerfaces_2, Material=colour_swatch_2)
