# Grasshopper definition Hops_Runner.gh (Grasshopper 1.0.8)
# Copyright: Felix Brunold
# plug-ins: Heteroptera, Hops

seed_generator = SeedGenerator(Number=Button(), seed=125091)
data_recorder = DataRecorder(seed_generator, DataLimit=1, RecordData=True)
hops = Hops(
    CacheResultsInMemory=False,
    CacheSolveResults=False,
    RemoteSolveVersion=(0, 1, 0),
    ShowInput_Enabled=False,
    ShowInput_Path=False,
    SynchronousSolve=True)
hops_2 = Hops(
    Timestamp=data_recorder,
    CacheResultsInMemory=True,
    CacheSolveResults=False,
    RemoteDefinitionLocation="D:\Code\Geospiza\Geospiza\Dist\package-manager\rhino7\Resources\Simple_Cube_Example_Hops.gh",
    RemoteSolveVersion=(0, 1, 0),
    ShowInput_Enabled=False,
    ShowInput_Path=False,
    SynchronousSolve=True)  # -> Output, GeoOutput
panel = Panel(hops_2.Output)
