# Grasshopper definition Simple_Cube_Example_Hops.gh (Grasshopper 1.0.8)
# plug-ins: Geospiza

# ---- group: Genes
cube_vals = GenePool(Decimals=0, Maximum=10000, Minimum=5000, Value=[7495, 9321, 8594])

# ---- group: Get Genes
geneselector = GeneSelector(GeneParams=cube_vals, SearchDocument=False, Clear=False)
genes = Text(geneselector)

# ---- group: Geometric_Solver
list_item = ListItem(List=cube_vals, Index=0, Wrap=True)  # -> Item, Item1, Item2
unit_z = UnitZ(Factor=list_item.Item2)
rectangle = Rectangle(Plane=PlaneXY(0, 0, 0), XSize=list_item.Item, YSize=list_item.Item1, Radius=0)  # -> Rectangle, Length
extrude = Extrude(Base=rectangle.Rectangle, Direction=unit_z)
cap_holes = CapHoles(Brep=extrude)
geometry = Geometry(cap_holes)

# ----
area = Area(Geometry=cap_holes)  # -> Area, Centroid
stochasticuniversalsampling = StochasticUniversalSampling()

# ---- group: Fitness_Function
division = Division(A=area.Area, B="1000000")
number = Number(division)
fitness = Fitness(Fitness=number)

# ----
# Bake for hops
context_bake = ContextBake(GeoOutput=geometry)

pops = Slider(50, range=0..100)
mgen = Slider(10, range=0..10)
elite = Slider(1, range=0..10)
ibf = Slider(0.2, range=0..1)
manhattendistance = Slider(1, range=0..1)
cr = Slider(0.6, range=0..1)
mr = Slider(0.01, range=0..0.01)
pops_2 = Slider(4, range=0..10)
populationdiversity = PopulationDiversity(Threshold=pops_2)

inbreedingpairing = InbreedingPairing(InBreedingFactor=ibf, DistanceFunction=manhattendistance)
twopointcrossover = TwoPointCrossover(CrossoverRate=cr)
randommutation = RandomMutation(MutationRate=mr)

settings = Settings(
    PopulationSize=pops,
    MaxGenerations=mgen,
    EliteSize=elite,
    SelectionStrategy=stochasticuniversalsampling,
    PairingStrategy=inbreedingpairing,
    CrossoverStrategy=twopointcrossover,
    MutationStrategy=randommutation,
    TerminationStrategy=populationdiversity)
settings_2 = Data(settings)

forwebonly = Panel("0")
timestamp = GetInteger(forwebonly, {"0"}, selected=[], AtLeast=1, AtMost=1, Maximum=2147483647, Minimum=-2147483648, TreeAccess=False)
genes_2 = Text(genes)
settings_3 = Data(settings_2)
singleobjectivesolver = SingleObjectiveSolver(Genes=genes_2, Settings=settings_3, PreviewLevel=3, Timestamp=timestamp, Run=Button())  # -> Observer, StateManager, CurrentGeneration, IsRunning
panel = Panel(singleobjectivesolver.CurrentGeneration)
observer = Data(singleobjectivesolver.Observer)
statemanager = Data(singleobjectivesolver.StateManager)

# ---- group: Deconstruct_Result
observer_2 = Data(observer)
observer_3 = Observer(Observer=observer_2)  # -> Individuals, AverageFitness, BestFitness, WorstFitness, BestIndividual
data = Data(observer_3.Individuals)
individual = Individual(Individual=data)  # -> Fitness, Genes
decodegene = DecodeGene(Gene=individual.Genes)  # -> GeneName, GeneValue, GeneGuid

# ----
individualtojson = IndividualToJson(Individual=observer_3.Individuals)

# ---- group: Reinstate_Individuals
statemanager_2 = Data(statemanager)
individuals = Data(data)
individual_2 = Panel("5")
list_item_2 = ListItem(List=individuals, Index=individual_2, Wrap=True)
reinstateindividual = ReinstateIndividual(StateManager=statemanager_2, Individual=list_item_2, Reinstate=Button())

# ----
context_print = ContextPrint(Output=individualtojson)
