# Grasshopper definition HopsTest.gh (Grasshopper 1.0.8)
# plug-ins: Geospiza, Pufferfish

# ---- group: Genes
cube_vals = GenePool(Decimals=0, Maximum=500, Minimum=1, Value=[448, 415, 498])

# ---- group: Geometric_Solver
list_item = ListItem(List=cube_vals, Index=0, Wrap=True)  # -> Item, Item1, Item2
unit_z = UnitZ(Factor=list_item.Item2)
rectangle = Rectangle(Plane=PlaneXY(0, 0, 0), XSize=list_item.Item, YSize=list_item.Item1, Radius=0)  # -> Rectangle, Length
extrude = Extrude(Base=rectangle.Rectangle, Direction=unit_z)
cap_holes = CapHoles(Brep=extrude)
geometry = Geometry(cap_holes)

# ---- group: Get Genes
geneselector = GeneSelector(GeneParams=cube_vals)
genes = Text(geneselector)

# ----
ibf = Slider(0.2, range=0..1)
manhattendistance = Slider(1, range=0..1)
mr = Slider(0.01, range=0..0.01)
pops = Slider(4, range=0..10)
cr = Slider(0.6, range=0..1)
inbreedingpairing = InbreedingPairing(InBreedingFactor=ibf, DistanceFunction=manhattendistance)
twopointcrossover = TwoPointCrossover(CrossoverRate=cr)
randommutation = RandomMutation(MutationRate=mr)
populationdiversity = PopulationDiversity(Threshold=pops)
pops_2 = Slider(50, range=0..100)
mgen = Slider(10, range=0..10)
elite = Slider(1, range=0..10)
stochasticuniversalsampling = StochasticUniversalSampling()
settings = Settings(
    PopulationSize=pops_2,
    MaxGenerations=mgen,
    EliteSize=elite,
    SelectionStrategy=stochasticuniversalsampling,
    PairingStrategy=inbreedingpairing,
    CrossoverStrategy=twopointcrossover,
    MutationStrategy=randommutation,
    TerminationStrategy=populationdiversity)
settings_2 = Data(settings)

pops_3 = Slider(4, range=0..10)  # disabled
panel = Panel("""0.2
0.4""")  # disabled
manhattendistance_2 = Slider(1, range=0..1)  # disabled
panel_2 = Panel("""50
100""")  # disabled
populationdiversity_2 = PopulationDiversity(Threshold=pops_3)  # disabled
progressconvergence = ProgressConvergence(Threshold=0.1)  # disabled

# ---- group: Fitness_Function
volume = Volume(Geometry=cap_holes)  # -> Volume, Centroid
division = Division(A=volume.Volume, B="10000000")
number = Number(division)
addition = Addition(A=number)
fitness = Fitness(Fitness=addition)

# ----
inbreedingpairing_2 = InbreedingPairing(InBreedingFactor=panel, DistanceFunction=manhattendistance_2)  # disabled
merge = Merge(Data1=populationdiversity_2, Data2=progressconvergence)  # disabled
dynamicsettings = DynamicSettings(
    PopulationSizes=panel_2,
    MaxGenerations=mgen,
    EliteSizes=elite,
    SelectionStrategies=stochasticuniversalsampling,
    PairingStrategies=inbreedingpairing_2,
    CrossoverStrategies=twopointcrossover,
    MutationStrategies=randommutation,
    TerminationStrategies=merge)  # disabled

# ---- group: Geometric_Solver / RH_OUT: Data
geometry_2 = Geometry(geometry)

# ----
settings_3 = Data(settings_2)

forwebonly = Panel("9")
ts = GetInteger(
    forwebonly,
    {"0"}, selected=[],
    AtLeast=1,
    AtMost=1,
    Maximum=2147483647,
    Minimum=-2147483648,
    Prompt="ts",
    TreeAccess=False)
genes_2 = Text(genes)
singleobjectivesolver = SingleObjectiveSolver(Genes=genes_2, Settings=settings_3, PreviewLevel=0, Timestamp=ts, Run=Button())  # -> Observer, StateManager, CurrentGeneration, IsRunning
statemanager = Data(singleobjectivesolver.StateManager)
panel_3 = Panel(singleobjectivesolver.CurrentGeneration)
panel_4 = Panel(singleobjectivesolver.IsRunning)

observer = Data(singleobjectivesolver.Observer)
context_print = ContextPrint(NumberGeneration=panel_3)
observer_2 = Observer(Observer=observer)  # -> Individuals, AverageFitness, BestFitness, WorstFitness, BestIndividual
context_print_2 = ContextPrint(IsRunning=panel_4)
invert_boolean = InvertBoolean(Boolean=panel_4)  # -> Inverted, Number
k_means = KMeans(Individuals=observer_2.Individuals, Clusters="5", Activate=invert_boolean.Inverted)
list_item_2 = ListItem(List=reverse(observer_2.Individuals), Index=0, Wrap=True)
individual = Individual(Individual=k_means)  # -> Fitness, Genes
reinstateindividual = ReinstateIndividual(StateManager=singleobjectivesolver.StateManager, Individual=list_item_2, Reinstate=Button())
geospiza_link = GeospizaLink(Listen=False)
decodegene = DecodeGene(Gene=individual.Genes)  # -> GeneName, GeneValue, GeneGuid
