# Grasshopper definition Local_Solver_Example.gh (Grasshopper 1.0.8)
# plug-ins: Geospiza

# ---- group: Genes
cube_vals = GenePool(Decimals=0, Maximum=500, Minimum=1, Value=[479, 456, 397])

# ---- group: Geometric_Solver
list_item = ListItem(List=cube_vals, Index=0, Wrap=True)  # -> Item, Item1, Item2
unit_z = UnitZ(Factor=list_item.Item2)
rectangle = Rectangle(Plane=PlaneXY(0, 0, 0), XSize=list_item.Item, YSize=list_item.Item1, Radius=0)  # -> Rectangle, Length
extrude = Extrude(Base=rectangle.Rectangle, Direction=unit_z)
cap_holes = CapHoles(Brep=extrude)
geometry = Geometry(cap_holes)
geometry_2 = Geometry(geometry)

# ---- group: Get Genes
geneselector = GeneSelector(GeneParams=cube_vals)
genes = Text(geneselector)

# ----
ibf = Slider(0.2, range=0..1)
manhattendistance = Slider(1, range=0..1)
mr = Slider(0.01, range=0..0.01)
pops = Slider(4, range=0..10)
cr = Slider(0.6, range=0..1)
inbreedingpairing = InbreedingPairing(InBreedingFactor=ibf, DistanceFunction=manhattendistance)
twopointcrossover = TwoPointCrossover(CrossoverRate=cr)
randommutation = RandomMutation(MutationRate=mr)
populationdiversity = PopulationDiversity(Threshold=pops)
pops_2 = Slider(50, range=0..100)
mgen = Slider(10, range=0..10)
elite = Slider(1, range=0..10)
stochasticuniversalsampling = StochasticUniversalSampling()
settings = Settings(
    PopulationSize=pops_2,
    MaxGenerations=mgen,
    EliteSize=elite,
    SelectionStrategy=stochasticuniversalsampling,
    PairingStrategy=inbreedingpairing,
    CrossoverStrategy=twopointcrossover,
    MutationStrategy=randommutation,
    TerminationStrategy=populationdiversity)
settings_2 = Data(settings)

# ---- group: Fitness_Function
volume = Volume(Geometry=cap_holes)  # -> Volume, Centroid
division = Division(A=volume.Volume, B="10000000")
number = Number(division)
addition = Addition(A=number)
fitness = Fitness(Fitness=addition)

# ----
genes_2 = Text(genes)

settings_3 = Data(settings_2)
basic_solver = BasicSolver(Genes=genes_2, Settings=settings_3, PreviewLevel=0, Run=Button())  # -> Observer, StateManager, CurrentGeneration, IsRunning
observer = Observer(Observer=basic_solver.Observer)  # -> Individuals, AverageFitness, BestFitness, WorstFitness, BestIndividual
state_manager = Data(basic_solver.StateManager)
individuals = Data(observer.Individuals)

individuals_2 = Data(individuals)
state_manager_2 = Data(state_manager)
list_item_2 = ListItem(List=individuals_2, Index=0, Wrap=True)
reinstate_individual = ReinstateIndividual(StateManager=state_manager_2, Individual=list_item_2, Reinstate=Button())

individuals_3 = Data(individuals)  # disabled
number_slider = Slider(7, range=0..10)  # disabled
boolean_toggle = BooleanToggle(True)  # disabled
k_means = KMeans(Individuals=individuals_3, Clusters=number_slider, Activate=boolean_toggle)  # disabled
individuals_4 = Data(k_means)  # disabled
