# Grasshopper definition Web_Solver_Example.gh (Grasshopper 1.0.8)
# plug-ins: Geospiza

# ---- group: Genes
cube_vals = GenePool(Decimals=0, Maximum=500, Minimum=1, Value=[482, 471, 463])

# ---- group: Geometric_Solver
list_item = ListItem(List=cube_vals, Index=0, Wrap=True)  # -> Item, Item1, Item2
unit_z = UnitZ(Factor=list_item.Item2)
rectangle = Rectangle(Plane=PlaneXY(0, 0, 0), XSize=list_item.Item, YSize=list_item.Item1, Radius=0)  # -> Rectangle, Length
extrude = Extrude(Base=rectangle.Rectangle, Direction=unit_z)
cap_holes = CapHoles(Brep=extrude)
geometry = Geometry(cap_holes)
geometry_2 = Geometry(geometry)

# ---- group: Get Genes
geneselector = GeneSelector(GeneParams=cube_vals)
genes = Text(geneselector)

# ----
ibf = Slider(0, range=0..1)
manhattendistance = Slider(1, range=0..1)
mr = Slider(0.005, range=0..0.71)
pops = Slider(4, range=0..10)
cr = Slider(0.001, range=0..1)
inbreedingpairing = InbreedingPairing(InBreedingFactor=ibf, DistanceFunction=manhattendistance)
twopointcrossover = TwoPointCrossover(CrossoverRate=cr)
randommutation = RandomMutation(MutationRate=mr)
populationdiversity = PopulationDiversity(Threshold=pops)
pops_2 = Slider(100, range=0..100)
mgen = Slider(10, range=0..10)
elite = Slider(0, range=0..10)
stochasticuniversalsampling = StochasticUniversalSampling()
settings = Settings(
    PopulationSize=pops_2,
    MaxGenerations=mgen,
    EliteSize=elite,
    SelectionStrategy=stochasticuniversalsampling,
    PairingStrategy=inbreedingpairing,
    CrossoverStrategy=twopointcrossover,
    MutationStrategy=randommutation,
    TerminationStrategy=populationdiversity)
settings_2 = Data(settings)

# ---- group: Fitness_Function
volume = Volume(Geometry=cap_holes)  # -> Volume, Centroid
division = Division(A=volume.Volume, B="10000000")
number = Number(division)
addition = Addition(A=number)
fitness = Fitness(Fitness=addition)

# ----
three_material = ThreeMaterial(Color=ColourSwatch(SwatchColor=RGB(0, 0, 0)), Metalness=0, Roughness=0.5, Opacity=1)
web_individual = WebIndividual(Geo=geometry_2, ThreeMaterial=three_material)
web_individual_2 = Data(web_individual)

genes_2 = Text(genes)
settings_3 = Data(settings_2)
web_individual_3 = Data(web_individual_2)
web_solver = WebSolver(
    Genes=genes_2,
    Settings=settings_3,
    Activate=Toggle(True),
    Endpoint="ws://127.0.0.1:8181",
    WebIndividual=web_individual_3)  # -> Message, Observer
